# Grasshopper definition meArm_InverseKinematics.gh (Grasshopper 1.0.7)
# Copyright: 2021
# plug-ins: Firefly.Core

# ---- group: Use this if your arm dimension are different
crv = Curve(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)
crv_2 = Curve(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)
crv_3 = Curve(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)
crv_4 = Curve(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)
crv_5 = Curve(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)
crv_6 = Curve(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)
crv_7 = Curve(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)
crv_8 = Curve(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)
crv_9 = Curve(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)
customme = CustomSkeleton(
    gripper=crv_3,
    top_link=crv_6,
    main_link=crv_4,
    elbow=crv_7,
    left_link=crv,
    left=crv_8,
    right=crv_5,
    stablizer=crv_9,
    base=crv_2)

# ---- group: Generate target
crv_10 = Curve(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)
curvepoint = PointOnCurve(crv_10, parameter=0)

# ----
mearm = MeArm(target=curvepoint)  # -> skeleton, gripper_location, servo_angles
mearm_2 = MeArmIK(Target=curvepoint)  # -> Crv, Txt; inputs Target: Point3d, Custom: tree of Polyline
# ---------- mearm_2: C# usings ----------
using System.Linq;
using System.Text;
using System.Windows.Forms;
# ---------- mearm_2: C# ----------
    this.Component.Name = "MeArm IK";
    this.Component.NickName = "MeArm";
    this.Component.Description = "IK Solver for MeArm";
    this.Component.Params.Input[0].Description = "Point Target for IK calculations";
    this.Component.Params.Input[1].Description = "Use custom skeleton for IK calculations";
    this.Component.Params.Output[0].Description = "Simplified Skeleton representation";
    this.Component.Params.Output[1].Description = "Serial data to be send to Arduino";

    double[,] dhpt = new double[4, 4]{
      {0,-Math.PI / 2,15,73},
      {0,0,80,0},
      {0,0,80,0},
      {0,Math.PI / 2,52.5,0}};
    double delta = 5.7;
    if(this.Component.Params.Input[1].SourceCount != 0)
    {
      Point3d[] pts = Custom.Branch(8)[0].ToArray();
      double[] z = new double[pts.Length];
      for(int j = 0; j < pts.Length;j++){
        z[j] = pts[j].Z;
      }
      Array.Sort(z, pts);
      Point3d[] pts2 = Custom.Branch(0)[0].ToArray();
      double[] x = new double[pts2.Length];
      for(int j = 0; j < pts2.Length;j++){
        x[j] = pts2[j].X;
      }
      Array.Sort(x, pts2);
      delta = pts2[0].Z - pts2.Last().Z;
      dhpt = new double[4, 4]{
        {0,-Math.PI / 2,pts[2].X,pts[2].Z},
        {0,0,Custom.Branch(6)[0].Length,0},
        {0,0,Custom.Branch(2)[0].GetSegments()[0].Length > Custom.Branch(2)[0].GetSegments()[1].Length ? Custom.Branch(2)[0].GetSegments()[0].Length : Custom.Branch(2)[0].GetSegments()[1].Length,0},
        {0,Math.PI / 2,pts2.Last().X - pts2[0].X,0}};
    }
    Target.Z += delta;

    double t0 = Math.Atan2(Target.Y, Target.X);
    double s3 = Math.Sqrt(Target.X * Target.X + Target.Y * Target.Y) - dhpt[0, 2] - dhpt[3, 2];
    double s4 = Target.Z - dhpt[0, 3];
    double l2 = s4 * s4 + s3 * s3;
    double t1 = Math.Acos((dhpt[2, 2] * dhpt[2, 2] - dhpt[1, 2] * dhpt[1, 2] - l2) / (-2 * dhpt[1, 2] * Math.Sqrt(l2))) + Math.Atan2(s4, s3);
    double t2 = Math.PI - Math.Acos((l2 - dhpt[1, 2] * dhpt[1, 2] - dhpt[2, 2] * dhpt[2, 2]) / (-2 * dhpt[1, 2] * dhpt[2, 2]));

    if(double.IsNaN(t2) || t0 > Math.PI / 2 || t0 < -Math.PI / 2 || t1 < 0 || t1 > 180 || t1 - t2 >= 0)
    {
      Txt = "ERROR";
      return;
    }
    Txt = Serial(t0, t1, t2);

    dhpt[0, 0] = t0;
    dhpt[1, 0] = -t1;
    dhpt[2, 0] = t2;
    dhpt[3, 0] = t1 - t2;

    double[,] h01 = DHTM(dhpt, 0);
    double[,] h12 = DHTM(dhpt, 1);
    double[,] h23 = DHTM(dhpt, 2);
    double[,] h34 = DHTM(dhpt, 3);

    double[,] h02 = Dot(h01, h12);
    double[,] h03 = Dot(h02, h23);
    double[,] h04 = Dot(h03, h34);
    h04[2, 3] -= delta;

    Point3d[] pt = new Point3d[5]{
      new Point3d(0, 0, 0),
      new Point3d(0, 0, 0),
      new Point3d(0, 0, 0),
      new Point3d(0, 0, 0),
      new Point3d(0, 0, 0),
      };
    pt[1].Transform(Transform.ChangeBasis(new Plane(new Point3d(h01[0, 3], h01[1, 3], h01[2, 3]), new Vector3d(h01[0, 0], h01[1, 0], h01[2, 0]), new Vector3d(h01[0, 1], h01[1, 1], h01[2, 1])), Plane.WorldXY));
    pt[2].Transform(Transform.ChangeBasis(new Plane(new Point3d(h02[0, 3], h02[1, 3], h02[2, 3]), new Vector3d(h02[0, 0], h02[1, 0], h02[2, 0]), new Vector3d(h02[0, 1], h02[1, 1], h02[2, 1])), Plane.WorldXY));
    pt[3].Transform(Transform.ChangeBasis(new Plane(new Point3d(h03[0, 3], h03[1, 3], h03[2, 3]), new Vector3d(h03[0, 0], h03[1, 0], h03[2, 0]), new Vector3d(h03[0, 1], h03[1, 1], h03[2, 1])), Plane.WorldXY));
    pt[4].Transform(Transform.ChangeBasis(new Plane(new Point3d(h04[0, 3], h04[1, 3], h04[2, 3]), new Vector3d(h04[0, 0], h04[1, 0], h04[2, 0]), new Vector3d(h04[0, 1], h04[1, 1], h04[2, 1])), Plane.WorldXY));
    Crv = new Polyline(pt);
# ---------- mearm_2: C# additional code ----------
  string Serial(double t0, double t1, double t2)
  {
    return Math.Round((t0 * 180 / Math.PI) + 90).ToString("000")
      + Math.Round((Math.PI - t1) * (180 / Math.PI)).ToString("000")
      + Math.Round((Math.PI - (t2 - t1)) * 180 / Math.PI).ToString("000");
  }
  double[,] DHTM(double[,] dhpt, int r)
  {
    return new double[4, 4]{
      {Math.Cos(dhpt[r, 0]), -Math.Sin(dhpt[r, 0]) * Math.Cos(dhpt[r, 1]), Math.Sin(dhpt[r, 0]) * Math.Sin(dhpt[r, 1]), dhpt[r, 2] * Math.Cos(dhpt[r, 0])},
      {Math.Sin(dhpt[r, 0]), Math.Cos(dhpt[r, 0]) * Math.Cos(dhpt[r, 1]), -Math.Cos(dhpt[r, 0]) * Math.Sin(dhpt[r, 1]), dhpt[r, 2] * Math.Sin(dhpt[r, 0])},
      {0, Math.Sin(dhpt[r, 1]), Math.Cos(dhpt[r, 1]), dhpt[r, 3]},
      {0, 0, 0, 1}};
  }

  double[,] Dot(double[,] A, double[,] B)
  {
    int rA = A.GetLength(0);
    int cA = A.GetLength(1);
    int rB = B.GetLength(0);
    int cB = B.GetLength(1);
    double sum;
    double[,] result = new double[rA, cB];
    for (int i = 0; i < rA; i++)
    {
      for (int j = 0; j < cB; j++)
      {
        sum = 0;
        for(int k = 0;k < cA;k++)
        {
          sum += A[i, k] * B[k, j];
        }
        result[i, j] = sum;
      }
    }
    return result;
  }
# ---------- end mearm_2 ----------

# ---- group: Manual Gripper Control Append gripper value
list = ValueList({"Gripper Open": 90, "Gripper Close": 120}, selected="Gripper Open")
merge = Merge(Data1=flatten(mearm_2.Txt), Data2=list)
join = TextJoin(Text=merge)

# ---- group: Serial Message Uses Firefly plugin
toggle = BooleanToggle(False)
ports_available = COMPortsAvailable()  # disabled
write = SerialWriteGeneric(StartWritingValues=toggle, WriteData=join, PortNumber=ports_available)  # -> ArduinoOutput, StatusMessage
open_port = OpenClosePort(OpenClosePort=toggle, PortNumber=ports_available, BaudRate="9600")

# ==== cluster CustomSkeleton: Define custom skeleton for MeArm IK
left = ClusterInput()  # Left motor angle (Line)
left_link = ClusterInput()  # Link between left servo and main link (Line)
right = ClusterInput()  # Right motor angle (Line)
stablizer = ClusterInput()  # Stable link between right and elbow triangle (Line)
base = ClusterInput()  # ZigZag curve that looks like a 7 representing the base and center of rotation (3 segment Polyline)
elbow = ClusterInput()  # Triangle that acts as the elbow (Closed Polyline)
gripper = ClusterInput()  # Triangle Representing Gripper (Closed Polyline)
main_link = ClusterInput()  # Main link between gripper and elbow (2 segment Polyline)
top_link = ClusterInput()  # Top link between the gripper and elbow (Line)
entwine = Entwine(
    Branch00=gripper,
    Branch01=top_link,
    Branch02=main_link,
    Branch03=elbow,
    Branch04=left_link,
    Branch05=left,
    Branch06=right,
    Branch07=stablizer,
    Branch08=base,
    FlattenInputs=True)
join = JoinCurves(Curves=entwine, Preserve=False)
custom_skeleton = ClusterOutput(join)  # Custom Skeleton for MeArm IK

# ==== cluster MeArm: IK solver for MeArm
custom_skeleton = ClusterInput()  # {0;0} [Gripper Triangle (3 segment Polyline)] {0;1} [Top Link (Line)] {0;2} [Main Link (2 segment Polyline)] {0;3} [Elbow Triangle (3 segment Polyline)] {0;4} [Left Link (Line)] {0;5} [Left (Line)] {0;6} [Right (Line)] {0;7} [Rear Stablizer (Line)] {0;8} [Base ZigZag (3 segment Polyline)]
bang = ExplodeTree(Data=custom_skeleton)  # -> Branch0, Branch1, Branch2, Branch3, Branch4, Branch5, Branch6, Branch7, Branch8
target = ClusterInput()  # Target location of gripper (Point)
target_2 = Point(Point(89.79008418, 0, 70.54096658))
gripper = Curve(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)
top_link = Curve(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)
link = Curve(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)
triangle = Curve(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)
l_link = Curve(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)
L = Curve(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)
R = Curve(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)
stablizer = Curve(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)
base = Curve(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)
entwine = Entwine(
    Branch00=gripper,
    Branch01=top_link,
    Branch02=link,
    Branch03=triangle,
    Branch04=l_link,
    Branch05=L,
    Branch06=R,
    Branch07=stablizer,
    Branch08=base,
    FlattenInputs=True)
combine = CombineData(Input0=target, Input1=target_2)  # -> Result, Index
combine_2 = CombineData(Input0=bang.Branch0, Input1=gripper)  # -> Result, Index
combine_3 = CombineData(Input0=bang.Branch8, Input1=base)  # -> Result, Index
combine_4 = CombineData(Input0=custom_skeleton, Input1=entwine)  # -> Result, Index
disc = Discontinuity(Curve=combine_3.Result, Level=3)  # -> Points, Parameters
disc_2 = Discontinuity(Curve=combine_2.Result, Level=3)  # -> Points, Parameters
expression = Expression(x=disc.Points, Expression="x.z")
expression_2 = Expression(x=disc_2.Points, Expression="x.x")
explode = Explode(Curve=combine_4.Result, Recursive=True)  # -> Segments, Vertices
disc_3 = Discontinuity(Curve=combine_4.Result, Level=3)  # -> Points, Parameters
sort = SortList(Keys=expression, ValuesA=disc.Points)  # -> Keys, ValuesA
sort_2 = SortList(Keys=expression_2, ValuesA=disc_2.Points)  # -> Keys, reverse(ValuesA)
split = SplitList(List=sort.ValuesA, Index=2)  # -> ListA, ListB
item = ListItem(List=sort_2.ValuesA, Index=0, Wrap=True)
coplanar = CoPlanar(Points=flatten(disc_3.Points), Strength="100")
anchorxyz = AnchorXYZ(Point=split.ListB, X=False, Y=False, Z=invert(False), Strength="100")
rigidpointset = RigidPointSet(Points=disc_3.Points, Strength="100")  # -> RigidBody, Planes
anchor = Anchor(Point=item, Target=combine.Result, Strength="1")
anchor_2 = Anchor(Point=split.ListA, Strength="100")
length_line = LengthLine(Line=explode.Segments, Strength="100")
show = Show(G=item)
show_2 = Show(G=explode.Segments)
merge = Merge(Data1=anchor, Data2=length_line, Data3=coplanar, Data4=rigidpointset.RigidBody, Data5=anchor_2, Data6=anchorxyz)
entwine_2 = Entwine(Branch00=show_2, Branch01=show, Branch02=merge, FlattenInputs=True)
zombiesolver = ZombieSolver(GoalObjects=entwine_2, Threshold=1e-10, Tolerance=0.01, MaxIterations=1500)  # -> I, V, O
lng = ListLength(List=entwine_2)  # -> flatten(Length)
lng_2 = ListLength(List=explode.Segments)  # -> flatten(Length)
partition = PartitionList(List=zombiesolver.O, Size=lng)
bang_2 = ExplodeTree(Data=simplify(partition))  # -> Branch0, Branch1, Branch2
pdecon = Deconstruct(Point=bang_2.Branch1)  # -> XComponent, YComponent, ZComponent
Y = UnitY(Factor=1)
vec = VectorXYZ(XComponent=pdecon.XComponent, YComponent=pdecon.YComponent, ZComponent=0)  # -> Vector, Length
crv = Curve(bang_2.Branch0)
neg = Negative(Value=Y)
partition_2 = PartitionList(List=bang_2.Branch0, Size=lng_2)
neg_2 = Negative(Value=vec.Vector)
skeleton = ClusterOutput(crv)  # Skeleton curves of solution
pt = Point(bang_2.Branch1)
bang_3 = ExplodeTree(Data=partition_2)  # -> Branch0, Branch1, Branch2, Branch3, Branch4, Branch5, Branch6, Branch7, Branch8
project = Project(Geometry=bang_2.Branch1, Plane=PlaneXY(0, 0, 0))  # -> Geometry, Transform
gripper_location = ClusterOutput(pt)  # Point of gripper location
angle = Angle(VectorA=bang_3.Branch6, VectorB=neg_2)  # -> Angle, Reflex
angle_2 = Angle(VectorA=bang_3.Branch5, VectorB=vec.Vector)  # -> Angle, Reflex
angle_3 = Angle(VectorA=neg, VectorB=project.Geometry)  # -> Angle, Reflex
len = Length(Curve=bang_3.Branch2)
deg = Degrees(Radians=angle_2.Angle)
deg_2 = Degrees(Radians=angle_3.Angle)
sort_3 = SortList(Keys=len, ValuesA=bang_3.Branch2)  # -> Keys, reverse(ValuesA)
item_2 = ListItem(List=sort_3.ValuesA, Index=0, Wrap=True)
subtraction = Subtraction(A="180", B=deg)
deg_3 = Degrees(Radians=angle.Angle)
entwine_3 = Entwine(Branch00=deg_2, Branch01=deg_3, Branch02=deg, FlattenInputs=True)  # -> flatten(Result)
vec_2 = Vector(unitize(item_2))
vec_3 = Vector(unitize(bang_3.Branch1))
int = Integer(entwine_3)
larger = LargerThan(FirstNumber=subtraction, SecondNumber=deg_3)  # -> LargerThan, OrEqualTo
xprod = CrossProduct(VectorA=vec_3, VectorB=vec_2, Unitize=False)  # -> Vector, Length
addition = Addition(A=int, B=1000)
larger_2 = LargerThan(FirstNumber=xprod.Length, SecondNumber=0.02)  # -> LargerThan, OrEqualTo
fragment = TextFragment(Text=addition, Start=1)
or = GateOr(A=larger_2.OrEqualTo, B=larger.OrEqualTo)
join = TextJoin(Text=fragment)
filter = StreamFilter(Gate=or, Stream0=join, Stream1="ERROR")
servo_angles = ClusterOutput(filter)  # A string representing each motor angle seperated by a comma (Base, Right Left)
