# Grasshopper definition meArm_InverseKinematics_K2.gh (Grasshopper 1.0.7)
# Copyright: 2021
# plug-ins: Firefly.Core

# ---- group: Use this if your arm dimension are different
crv = Curve(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)
crv_2 = Curve(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)
crv_3 = Curve(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)
crv_4 = Curve(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)
crv_5 = Curve(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)
crv_6 = Curve(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)
crv_7 = Curve(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)
crv_8 = Curve(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)
crv_9 = Curve(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)
customme = CustomSkeleton(
    gripper=crv_3,
    elbow_link=crv_6,
    main_link=crv_4,
    shoulder=crv_7,
    left_link=crv,
    left=crv_8,
    right=crv_5,
    stablizer=crv_9,
    base=crv_2)

# ---- group: Generate target
crv_10 = Curve(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)
curvepoint = PointOnCurve(crv_10, parameter=0)

# ---- group: IK Solver
mearm = MeArm(target=curvepoint)  # -> skeleton, gripper_location, servo_angles

# ---- group: Manual Gripper Control Append gripper value
list = ValueList({"Gripper Open": 90, "Gripper Close": 120}, selected="Gripper Open")
merge = Merge(Data1=mearm.servo_angles, Data2=list)
join = TextJoin(Text=merge, Join=",")

# ---- group: Serial Message Uses Firefly plugin
toggle = BooleanToggle(False)
ports_available = COMPortsAvailable()
panel = Panel(join)
write = SerialWriteGeneric(StartWritingValues=toggle, WriteData=join, PortNumber=ports_available)  # -> ArduinoOutput, StatusMessage
open_port = OpenClosePort(OpenClosePort=toggle, PortNumber=ports_available, BaudRate="9600")

# ==== cluster CustomSkeleton: Define custom skeleton for MeArm IK
left = ClusterInput()  # Left motor angle (Line)
left_link = ClusterInput()  # Link between left servo and main link (Line)
right = ClusterInput()  # Right motor angle (Line)
stablizer = ClusterInput()  # Stable link between right and elbow triangle (Line)
base = ClusterInput()  # ZigZag curve that looks like a 7 representing the base and center of rotation (3 segment Polyline)
shoulder = ClusterInput()  # Triangle that acts as the elbow (Closed Polyline)
elbow_link = ClusterInput()  # Top link between the gripper and elbow (Line)
gripper = ClusterInput()  # Triangle Representing Gripper (Closed Polyline)
main_link = ClusterInput()  # Main link between gripper and elbow (2 segment Polyline)
entwine = Entwine(
    Branch00=gripper,
    Branch01=elbow_link,
    Branch02=main_link,
    Branch03=shoulder,
    Branch04=left_link,
    Branch05=left,
    Branch06=right,
    Branch07=stablizer,
    Branch08=base,
    FlattenInputs=True)
custom_skeleton = ClusterOutput(entwine)  # Custom Skeleton for MeArm IK

# ==== cluster MeArm: IK solver for MeArm
custom_skeleton = ClusterInput()  # {0;0} [Gripper Triangle (3 segment Polyline)] {0;1} [Top Link (Line)] {0;2} [Main Link (2 segment Polyline)] {0;3} [Elbow Triangle (3 segment Polyline)] {0;4} [Left Link (Line)] {0;5} [Left (Line)] {0;6} [Right (Line)] {0;7} [Rear Stablizer (Line)] {0;8} [Base ZigZag (3 segment Polyline)]
beautify = BeautifyCluster()  # -> out
# ---------- beautify: C# usings ----------
using System.Reflection;
using Grasshopper.Kernel.Special;
using System.Windows.Forms;
using System.Linq;
# ---------- beautify: C# ----------
    this.Component.Name = "Beautify Cluster";
    this.Component.NickName = "Beautify";
    this.Component.Description = "Include this component inside clusters to beautify the cluster";
    Beautify();
# ---------- beautify: C# additional code ----------
  public GH_Document ghDoc{
    get{
      return this.GrasshopperDocument;
    }
  }
  public GH_Cluster thisCluster{
    get{
      return ghDoc.Owner.OwnerDocument().FindClusters(ghDoc.DocumentID)[0];
    }
  }

  private void Beautify(){
    if(Component.Attributes.GetType() != typeof(Custom)){
      Component.Attributes = new Custom(Component);
      ghDoc.DestroyAttributeCache();
    }
    if(thisCluster.Attributes.GetType() != typeof(CustomCluster)){
      thisCluster.Attributes = new CustomCluster(thisCluster);
      ghDoc.Owner.OwnerDocument().DestroyAttributeCache();
    }
  }

  public class Custom : Grasshopper.Kernel.Attributes.GH_ComponentAttributes{
    public Custom(IGH_Component comp) : base(comp){
      this.Pivot = comp.Attributes.Pivot;
    }
    public override Grasshopper.GUI.Canvas.GH_ObjectResponse RespondToMouseDoubleClick(Grasshopper.GUI.Canvas.GH_Canvas s, Grasshopper.GUI.GH_CanvasMouseEvent e){
      return Grasshopper.GUI.Canvas.GH_ObjectResponse.Handled;
    }

    public override Grasshopper.GUI.Canvas.GH_ObjectResponse RespondToMouseUp(Grasshopper.GUI.Canvas.GH_Canvas s, Grasshopper.GUI.GH_CanvasMouseEvent e){
      if (e.Button != System.Windows.Forms.MouseButtons.Right
        || ((Control.ModifierKeys == Keys.Control) && Control.IsKeyLocked(Keys.CapsLock)))
        return base.RespondToMouseUp(s, e);
      else
        return Grasshopper.GUI.Canvas.GH_ObjectResponse.Handled;
    }
  }

  public class CustomCluster : Grasshopper.Kernel.Attributes.GH_ComponentAttributes{
    ClusterMenuStrip menu = null;

    public CustomCluster(GH_Cluster cluster) : base(cluster){
      this.Pivot = cluster.Attributes.Pivot;
      this.Bounds = cluster.Attributes.Bounds;
      this.Selected = cluster.Attributes.Selected;
    }

    public override void SetupTooltip(System.Drawing.PointF point, Grasshopper.GUI.GH_TooltipDisplayEventArgs e){
      e.Title = this.Owner.NickName;
      e.Text = this.Owner.Description;
      e.Icon = this.Owner.Icon_24x24;

      Type t = typeof(GH_Cluster);
      FieldInfo f = t.GetField("m_author", BindingFlags.Instance | BindingFlags.NonPublic);
      GH_Author Author = f.GetValue((GH_Cluster) this.Owner) as GH_Author;

      if(Author != null && !Author.IsEmpty){
        e.Description = Author.Name + "\r\n" + Author.Copyright;
      }
    }

    public override Grasshopper.GUI.Canvas.GH_ObjectResponse RespondToMouseDoubleClick(Grasshopper.GUI.Canvas.GH_Canvas s, Grasshopper.GUI.GH_CanvasMouseEvent e){
      return Grasshopper.GUI.Canvas.GH_ObjectResponse.Handled;
    }

    public override Grasshopper.GUI.Canvas.GH_ObjectResponse RespondToMouseUp(Grasshopper.GUI.Canvas.GH_Canvas s, Grasshopper.GUI.GH_CanvasMouseEvent e){
      if (e.Button != System.Windows.Forms.MouseButtons.Right
        || ((Control.ModifierKeys == Keys.Control) && Control.IsKeyLocked(Keys.CapsLock)))
        return base.RespondToMouseUp(s, e);
      else{
        if (menu == null){
          menu = new ClusterMenuStrip(this.DocObject);
          this.DocObject.AppendMenuItems(menu);
          menu = removeDefaultClusterMenuItems(menu);
        }
        s.ActiveInteraction = null;
        System.Drawing.Point location = Instances.DocumentEditor.PointToClient(Cursor.Position);
        menu.Show(Instances.DocumentEditor, location);
        return Grasshopper.GUI.Canvas.GH_ObjectResponse.Handled;
      }
    }


    private class ClusterMenuStrip : System.Windows.Forms.ContextMenuStrip{
      private IGH_DocumentObject docObject;

      public ClusterMenuStrip(IGH_DocumentObject owner){
        this.docObject = owner;
      }

      protected override bool ProcessCmdKey(ref System.Windows.Forms.Message m, System.Windows.Forms.Keys keyData){
        return (keyData == System.Windows.Forms.Keys.Return && this.RespondToEnter()) || base.ProcessCmdKey(ref m, keyData);
      }

      private bool RespondToEnter(){
        try
        {
          System.Collections.IEnumerator enumerator = this.Items.GetEnumerator();
          while (enumerator.MoveNext()){
            System.Windows.Forms.ToolStripItem item = (System.Windows.Forms.ToolStripItem) enumerator.Current;
            if (this.RespondToEnter(item)){
              return true;
            }
          }
        }
        finally{
        }
        return false;
      }

      private bool RespondToEnter(System.Windows.Forms.ToolStripItem item){
        if (item is Grasshopper.GUI.IGH_ToolstripItemKeyHandler){
          switch (((Grasshopper.GUI.IGH_ToolstripItemKeyHandler) item).RespondToEnter()){
            case Grasshopper.GUI.GH_ToolstripItemKeyHandlerResult.Ignored:
              return false;
            case Grasshopper.GUI.GH_ToolstripItemKeyHandlerResult.CloseMenu:
              return false;
            case Grasshopper.GUI.GH_ToolstripItemKeyHandlerResult.MaintainMenu:
              return true;
          }
        }
        System.Windows.Forms.ToolStripControlHost hostItem = item as System.Windows.Forms.ToolStripControlHost;
        if (hostItem != null && hostItem.Control is Grasshopper.GUI.IGH_ToolstripItemKeyHandler){
          switch (((Grasshopper.GUI.IGH_ToolstripItemKeyHandler) hostItem.Control).RespondToEnter()){
            case Grasshopper.GUI.GH_ToolstripItemKeyHandlerResult.Ignored:
              return false;
            case Grasshopper.GUI.GH_ToolstripItemKeyHandlerResult.CloseMenu:
              return false;
            case Grasshopper.GUI.GH_ToolstripItemKeyHandlerResult.MaintainMenu:
              return true;
          }
        }
        System.Windows.Forms.ToolStripDropDownItem dropItem = item as System.Windows.Forms.ToolStripDropDownItem;
        if (dropItem != null && dropItem.DropDown != null && dropItem.DropDown.Visible){
          try{
            System.Collections.IEnumerator enumerator = dropItem.DropDownItems.GetEnumerator();
            while (enumerator.MoveNext()){
              System.Windows.Forms.ToolStripItem subitem = (System.Windows.Forms.ToolStripItem) enumerator.Current;
              if (this.RespondToEnter(subitem)){
                return true;
              }
            }
          }
          finally{
          }
          return false;
        }
        return false;
      }
    }
    private ClusterMenuStrip removeDefaultClusterMenuItems(ClusterMenuStrip objectMenu){
      List<ToolStripItem> toRemove = new List<ToolStripItem>();
      List<string> defaults = new List<string>{
          "Preview Contents",
          "Edit Cluster…",
          "Properties…",
          "Change Password…",
          "Assign Password…",
          "Disentangle",
          "Export…",
          "Export && Reference…",
          "Update",
          "Internalise",
          "Variable Parameters",
          "Explode Cluster"
          };

      foreach(ToolStripItem o in objectMenu.Items){
        if(defaults.Where(x => o.Text.StartsWith(x)).ToList().Count > 0)
          toRemove.Add(o);
      }

      int separators = 0;
      for(int i = objectMenu.Items.Count - 1; i >= 0; i--)
        if(objectMenu.Items[i].GetType() == typeof(ToolStripSeparator)){
          toRemove.Add(objectMenu.Items[i]);
          separators++;
          if(separators > 2)
            break;
        }

      foreach(ToolStripItem o in toRemove)
        objectMenu.Items.Remove(o);

      int firstSeparatorIndex = -1;
      int counter = 0;
      for(int i = objectMenu.Items.Count - 1; i >= 0; i--){
        ToolStripItem item = objectMenu.Items[i];
        if(item.GetType() == typeof(ToolStripSeparator)){
          counter++;
          if(counter >= 2)
          {
            firstSeparatorIndex = i;
            break;
          }
        }
      }
      return objectMenu;
    }
  }
# ---------- end beautify ----------
bang = ExplodeTree(Data=custom_skeleton)  # -> Branch0, Branch1, Branch2, Branch3, Branch4, Branch5, Branch6, Branch7, Branch8
target = ClusterInput()  # Target location of gripper (Point)
target_2 = Point(Point(147, 0, 58))
gripper = Curve(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)
top_link = Curve(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)
link = Curve(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)
triangle = Curve(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)
l_link = Curve(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)
L = Curve(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)
R = Curve(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)
stablizer = Curve(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)
base = Curve(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)
combine = CombineData(Input0=target, Input1=target_2)  # -> Result, Index
combine_2 = CombineData(Input0=bang.Branch0, Input1=gripper)  # -> Result, Index
combine_3 = CombineData(Input0=bang.Branch1, Input1=top_link)  # -> Result, Index
combine_4 = CombineData(Input0=bang.Branch2, Input1=link)  # -> Result, Index
combine_5 = CombineData(Input0=bang.Branch3, Input1=triangle)  # -> Result, Index
combine_6 = CombineData(Input0=bang.Branch4, Input1=l_link)  # -> Result, Index
combine_7 = CombineData(Input0=bang.Branch5, Input1=L)  # -> Result, Index
combine_8 = CombineData(Input0=bang.Branch6, Input1=R)  # -> Result, Index
combine_9 = CombineData(Input0=bang.Branch7, Input1=stablizer)  # -> Result, Index
combine_10 = CombineData(Input0=bang.Branch8, Input1=base)  # -> Result, Index
disc = Discontinuity(Curve=combine_10.Result, Level=3)  # -> Points, Parameters
disc_2 = Discontinuity(Curve=combine_2.Result, Level=3)  # -> Points, Parameters
merge = Merge(
    Data1=combine_8.Result,
    Data2=combine_7.Result,
    Data3=combine_3.Result,
    Data4=combine_4.Result,
    Data5=combine_2.Result,
    Data6=combine_5.Result,
    Data7=combine_6.Result,
    Data8=combine_9.Result,
    Data9=combine_10.Result)
expression = Expression(x=disc.Points, Expression="x.z")
expression_2 = Expression(x=disc_2.Points, Expression="x.x")
explode = Explode(Curve=merge, Recursive=True)  # -> Segments, Vertices
disc_3 = Discontinuity(Curve=merge, Level=3)  # -> Points, Parameters
sort = SortList(Keys=expression, ValuesA=disc.Points)  # -> Keys, ValuesA
sort_2 = SortList(Keys=expression_2, ValuesA=disc_2.Points)  # -> Keys, reverse(ValuesA)
split = SplitList(List=sort.ValuesA, Index=2)  # -> ListA, ListB
item = ListItem(List=sort_2.ValuesA, Index=0, Wrap=True)
coplanar = CoPlanar(Points=flatten(disc_3.Points), Strength="100")
anchorxyz = AnchorXYZ(Point=split.ListB, X=False, Y=False, Z=invert(False), Strength="100")
rigidpointset = RigidPointSet(Points=disc_3.Points, Strength="100")  # -> RigidBody, Planes
anchor = Anchor(Point=item, Target=combine.Result, Strength="1")
anchor_2 = Anchor(Point=split.ListA, Strength="100")
length_line = LengthLine(Line=explode.Segments, Strength="100")
show = Show(G=item)
show_2 = Show(G=explode.Segments)
merge_2 = Merge(Data1=anchor, Data2=length_line, Data3=coplanar, Data4=rigidpointset.RigidBody, Data5=anchor_2, Data6=anchorxyz)
entwine = Entwine(Branch00=show_2, Branch01=show, Branch02=merge_2, FlattenInputs=True)
zombiesolver = ZombieSolver(GoalObjects=entwine, Threshold=1e-10, Tolerance=0.01, MaxIterations=1500)  # -> I, V, O
lng = ListLength(List=entwine)  # -> flatten(Length)
lng_2 = ListLength(List=explode.Segments)  # -> flatten(Length)
partition = PartitionList(List=zombiesolver.O, Size=lng)
bang_2 = ExplodeTree(Data=simplify(partition))  # -> Branch0, Branch1, Branch2
pdecon = Deconstruct(Point=bang_2.Branch1)  # -> XComponent, YComponent, ZComponent
Y = UnitY(Factor=1)
vec = VectorXYZ(XComponent=pdecon.XComponent, YComponent=pdecon.YComponent, ZComponent=0)  # -> Vector, Length
crv = Curve(bang_2.Branch0)
neg = Negative(Value=Y)
partition_2 = PartitionList(List=bang_2.Branch0, Size=lng_2)
neg_2 = Negative(Value=vec.Vector)
skeleton = ClusterOutput(crv)  # Skeleton curves of solution
pt = Point(bang_2.Branch1)
bang_3 = ExplodeTree(Data=partition_2)  # -> Branch0, Branch1, Branch2, Branch3, Branch4, Branch5, Branch6, Branch7, Branch8
gripper_location = ClusterOutput(pt)  # Point of gripper location
angle = Angle(VectorA=bang_3.Branch6, VectorB=neg_2)  # -> Angle, Reflex
angle_2 = Angle(VectorA=bang_3.Branch5, VectorB=vec.Vector)  # -> Angle, Reflex
angle_3 = Angle(VectorA=neg, VectorB=bang_2.Branch1)  # -> Angle, Reflex
len = Length(Curve=bang_3.Branch2)
deg = Degrees(Radians=angle_2.Angle)
deg_2 = Degrees(Radians=angle_3.Angle)
sort_3 = SortList(Keys=len, ValuesA=bang_3.Branch2)  # -> Keys, reverse(ValuesA)
item_2 = ListItem(List=sort_3.ValuesA, Index=0, Wrap=True)
subtraction = Subtraction(A="180", B=deg)
deg_3 = Degrees(Radians=angle.Angle)
subtraction_2 = Subtraction(A=deg, B=17.14285714)
vec_2 = Vector(unitize(item_2))
vec_3 = Vector(unitize(bang_3.Branch1))
larger = LargerThan(FirstNumber=subtraction, SecondNumber=deg_3)  # -> LargerThan, OrEqualTo
xprod = CrossProduct(VectorA=vec_3, VectorB=vec_2, Unitize=False)  # -> Vector, Length
entwine_2 = Entwine(Branch00=deg_2, Branch01=deg_3, Branch02=subtraction_2, FlattenInputs=True)  # -> flatten(Result)
larger_2 = LargerThan(FirstNumber=xprod.Length, SecondNumber=0.02)  # -> LargerThan, OrEqualTo
int = Integer(entwine_2)
or = GateOr(A=larger_2.OrEqualTo, B=larger.OrEqualTo)
join = TextJoin(Text=int, Join=",")
filter = StreamFilter(Gate=or, Stream0=join, Stream1="ERROR")
servo_angles = ClusterOutput(filter)  # A string representing each motor angle seperated by a comma (Base, Right Left)
